# Grasshopper definition 00_hello_world.gh (Grasshopper 1.0.8)

python_3_script = Python3Script()  # -> out, a
# ---------- python_3_script: Python ----------
# r: compas_timber==1.0.1
# venv: sw25

import compas
import compas_timber

print(f"""Hello COMPAS World!
Installation successful!
COMPAS=v{compas.__version__}
compas_timber=v{compas_timber.__version__}""")
# ---------- end python_3_script ----------
panel = Panel(python_3_script.out)
