# Grasshopper definition 02_mesh.gh (Grasshopper 1.0.8)

mesh = Python3Script()  # -> out, mesh
# ---------- mesh: Python ----------
# r: compas_timber==1.0.1
# venv: sw25

import compas
from compas.datastructures import Mesh

mesh = Mesh.from_obj(compas.get("tubemesh.obj"))
# ---------- end mesh ----------
compas_draw = COMPASDraw(cg=mesh.mesh)  # -> rg
#   port cg: The COMPAS geometry or datastructure to be drawn.
#   port rg: The Rhino geometry object.
# ---------- compas_draw: Python ----------
# r: compas>=2.14.1
"""
Draws COMPAS geometry in Grasshopper.
"""

from typing import Any

import Grasshopper

from compas.scene import SceneObject


class CompasToRhinoGeometry(Grasshopper.Kernel.GH_ScriptInstance):
    def RunScript(self, cg):
        if not cg:
            return None

        return SceneObject(item=cg).draw()
# ---------- end compas_draw ----------
