# Grasshopper definition 03_mesh_with_scene.gh (Grasshopper 1.0.8)

mesh = Python3Script()  # -> out, mesh, geo
# ---------- mesh: Python ----------
# r: compas_timber==1.0.1
# venv: sw25

import compas
from compas.datastructures import Mesh
from compas.scene import Scene

mesh = Mesh.from_obj(compas.get("tubemesh.obj"))

scene = Scene()
scene.add(mesh)
geo = scene.draw()
# ---------- end mesh ----------
