# Grasshopper definition 04_parametric_mesh.gh (Grasshopper 1.0.8)

python_3_script = Python3Script(z_peak=Slider(0.01, range=0.01..3), radius_factor=Slider(1, range=1..40))  # -> out, mesh
# ---------- python_3_script: Python ----------
# r: compas_timber==1.0.1
# venv: sw25

from compas.datastructures import Mesh
mesh = Mesh.from_meshgrid(10, 30)

for v in mesh.vertices():
    x, y, z = mesh.vertex_coordinates(v)
    z = max(0, z_peak - (x**2 + y**2) / radius_factor)
    mesh.vertex_attribute(v, "z", z)
# ---------- end python_3_script ----------
compas_draw = COMPASDraw(cg=python_3_script.mesh)  # -> rg
#   port cg: The COMPAS geometry or datastructure to be drawn.
#   port rg: The Rhino geometry object.
# ---------- compas_draw: Python ----------
# r: compas>=2.14.1
"""
Draws COMPAS geometry in Grasshopper.
"""

from typing import Any

import Grasshopper

from compas.scene import SceneObject


class CompasToRhinoGeometry(Grasshopper.Kernel.GH_ScriptInstance):
    def RunScript(self, cg):
        if not cg:
            return None

        return SceneObject(item=cg).draw()
# ---------- end compas_draw ----------
