# Grasshopper definition 05_creating_elements.gh (Grasshopper 1.0.8)

# ----
# Beam Creation
mbox = MeshBox(Base={Plane=PlaneXY(0, 0, 0), X=Domain(-10, 10), Y=Domain(-10, 10), Z=Domain(-10, 10)}, XCount=1, YCount=1, ZCount=1)
geo = Geometry([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])
ct_beam = CTBeam(centerline=geo, width=Slider(1, range=0..1), height=Slider(10, range=0..10))  # -> Beam, Blank; inputs centerline: list, z_vector: list of Vector3d, width: list of Double, height: list of Double, category: list of String, updateRefObj: Boolean
#   port centerline: Referenced curve or line, Guid of curve or line in the active Rhino document.
#   port z_vector: Vector defining the orientation of the cross-section (corresponds to the height dimension). If None, a default will be taken.
#   port width: Width of the cross-section (usually the smaller dimension).
#   port height: Height of the cross-section (usually the larger dimension).
#   port category: Category of a beam.
#   port updateRefObj: (optional) If True, the attributes in the referenced object will be updated/overwritten with the new values given here.
#   port Beam: Beam object(s).
#   port Blank: Shape of the beam's blank.
# ---------- ct_beam: Python ----------
# r: compas_timber==1.0.1
# venv: sw25
"""Creates a Beam from a LineCurve."""

# flake8: noqa
import Grasshopper
import Rhino
import rhinoscriptsyntax as rs
import System
from compas.scene import Scene
from compas_rhino.conversions import line_to_compas
from compas_rhino.conversions import vector_to_compas

from compas_timber.elements import Beam as CTBeam
from compas_timber.ghpython.rhino_object_name_attributes import update_rhobj_attributes_name
from compas_timber.ghpython.ghcomponent_helpers import list_input_valid_cpython


class Beam_fromCurve(Grasshopper.Kernel.GH_ScriptInstance):
    def RunScript(self,
            centerline: System.Collections.Generic.List[object],
            z_vector: System.Collections.Generic.List[Rhino.Geometry.Vector3d],
            width: System.Collections.Generic.List[float],
            height: System.Collections.Generic.List[float],
            category: System.Collections.Generic.List[str],
            updateRefObj: bool):
        # minimum inputs required
        if not list_input_valid_cpython(ghenv, centerline, "Centerline"):
            return
        if not width:
            length = self._get_centerline_length(centerline)
            width = [length / 20]
        if not height:
            length = self._get_centerline_length(centerline)
            height = [length / 10]

        # reformat unset parameters for consistency
        if not z_vector:
            z_vector = [None]
        if not category:
            category = [None]

        beams = []
        blanks = []
        scene = Scene()

        if centerline and height and width:
            # check list lengths for consistency
            N = len(centerline)
            if len(z_vector) not in (0, 1, N):
                ghenv.Component.AddRuntimeMessage(
                    Grasshopper.Kernel.GH_RuntimeMessageLevel.Error, " In 'ZVector' I need either none, one or the same number of inputs as the Crv parameter."
                )
            if len(width) not in (1, N):
                ghenv.Component.AddRuntimeMessage(Grasshopper.Kernel.GH_RuntimeMessageLevel.Error, " In 'W' I need either one or the same number of inputs as the Crv parameter.")
            if len(height) not in (1, N):
                ghenv.Component.AddRuntimeMessage(Grasshopper.Kernel.GH_RuntimeMessageLevel.Error, " In 'H' I need either one or the same number of inputs as the Crv parameter.")
            if len(category) not in (0, 1, N):
                ghenv.Component.AddRuntimeMessage(
                    Grasshopper.Kernel.GH_RuntimeMessageLevel.Error, " In 'Category' I need either none, one or the same number of inputs as the Crv parameter."
                )

            # duplicate data if None or single value
            if len(z_vector) != N:
                z_vector = [z_vector[0] for _ in range(N)]
            if len(width) != N:
                width = [width[0] for _ in range(N)]
            if len(height) != N:
                height = [height[0] for _ in range(N)]
            if len(category) != N:
                category = [category[0] for _ in range(N)]

            for line, z, w, h, c in zip(centerline, z_vector, width, height, category):
                guid, geometry = self._get_guid_and_geometry(line)
                rhino_line = rs.coerceline(geometry)
                line = line_to_compas(rhino_line)

                z = vector_to_compas(z) if z else None
                beam = CTBeam.from_centerline(centerline=line, width=w, height=h, z_vector=z)
                beam.attributes["rhino_guid"] = str(guid) if guid else None
                beam.attributes["category"] = c
                if updateRefObj and guid:
                    update_rhobj_attributes_name(guid, "width", str(w))
                    update_rhobj_attributes_name(guid, "height", str(h))
                    update_rhobj_attributes_name(guid, "zvector", str(list(beam.frame.zaxis)))
                    update_rhobj_attributes_name(guid, "category", c)

                beams.append(beam)
                scene.add(beam.blank)

        blanks = scene.draw()

        return beams, blanks

    def _get_guid_and_geometry(self, line):
        # internalized curves and GH geometry will not have persistent GUIDs, referenced Rhino objects will
        # type hint on the input has to be 'ghdoc' for this to work
        guid = None
        geometry = line
        rhino_obj = Rhino.RhinoDoc.ActiveDoc.Objects.FindId(line)
        if rhino_obj:
            guid = line
            geometry = rhino_obj.Geometry
        return guid, geometry

    def _get_centerline_length(self, centerline):
        centerline_length = []
        for i in centerline:
            centerline_length.append(rs.CurveLength(i))
        if centerline_length:
            length_average = sum(centerline_length) / len(centerline_length)
        else:
            length_average = 1
        return length_average
# ---------- end ct_beam ----------
ct_beamsfrommeshedges = CTBeamsFromMeshEdges(mesh=mbox, width=Slider(1, range=0..1), height=Slider(1, range=0..10))  # -> Beams, BeamMap, Blanks; inputs mesh: Mesh, width: Double, height: Double, category: String
#   port mesh: Mesh whose edges are used to generate beams.
#   port width: Width of beams
#   port height: Height of beams
#   port category: Category assigned to beams that can be used to define joint rules.
#   port Beams: List of compas_timber Beams.
#   port BeamMap: a Data Tree with the beams organized by connection to a mesh vertex. Used to define joint rules using the Joint_Rules_From_List component.
#   port Blanks: Base beam geometry before adding features or joining operations
# ---------- ct_beamsfrommeshedges: Python ----------
# r: compas_timber==1.0.1
# venv: sw25
"""Creates a data-tree structure of Beams from edges of a Mesh."""

# flake8: noqa
import Grasshopper
import Rhino
import rhinoscriptsyntax as rs
from compas.geometry import Line
from compas.geometry import Vector
from compas.scene import Scene
from Grasshopper import DataTree
from Grasshopper.Kernel.Data import GH_Path

from compas_timber.elements import Beam
from compas_timber.ghpython.ghcomponent_helpers import item_input_valid_cpython


class BeamTreeFromMesh(Grasshopper.Kernel.GH_ScriptInstance):
    def RunScript(self,
            mesh: Rhino.Geometry.Mesh,
            width: float,
            height: float,
            category: str):
        # minimum inputs required
        if not item_input_valid_cpython(ghenv, mesh, "mesh"):
            return
        if not item_input_valid_cpython(ghenv, width, "width"):
            return
        if not item_input_valid_cpython(ghenv, height, "height"):
            return
        edge_index_pairs = []


        # points = rs.MeshVertices(mesh)
        # faces = rs.MeshFaceVertices(mesh)
        # normals = rs.MeshFaceNormals(mesh)
        
        points = rs.MeshVertices(mesh)
        faces = rs.MeshFaceVertices(mesh)
        normals = rs.MeshFaceNormals(mesh)

        points, pt_map = set_map(points)
        faces = [[pt_map[i] for i in face] for face in faces]

        for face in faces:  # get all the edges of the mesh
            for ind in range(len(face)):
                edge_set = set([face[ind - 1], face[ind]])
                if edge_set not in edge_index_pairs:
                    edge_index_pairs.append(edge_set)

        beam_Zs = []
        for pair in edge_index_pairs:  # get the z direction of the beam using the average of the adjacent face normals
            normal = Vector(0, 0, 0)
            count = 0
            for i, face in enumerate(faces):
                face = set(face)
                if pair.issubset(face):
                    count += 1
                    normal += normals[i]
            beam_Zs.append(normal * (1 / count))
        print(len(beam_Zs))
        scene = Scene()
        beam_list = []
        for edge, z in zip(edge_index_pairs, beam_Zs):  # create the beams from the edges
            edge = Line(points[list(edge)[0]], points[list(edge)[1]])
            beam = Beam.from_centerline(edge, width, height, z)
            if category:
                beam.attributes["category"] = category
            beam_list.append(beam)
            scene.add(beam.blank)

        beam_tree = []
        for i in range(len(points)):  # map the beams to the vertices. Each vertex will have a list of beams that are connected to it
            joint_beams = []
            for j, pair in enumerate(edge_index_pairs):
                if i in pair:
                    joint_beams.append(beam_list[j])
            beam_tree.append(joint_beams)

        dt = DataTree[object]()
        for i, beam_branch in enumerate(beam_tree):
            dt.AddRange(beam_branch, GH_Path(i))

        blanks = scene.draw()
        return beam_list, dt, blanks


def set_map(points):
    pts_out = []
    inds_out = []
    for i, pt in enumerate(points):
        if pt not in pts_out:
            pts_out.append(pt)
        inds_out.append(pts_out.index(pt))
    return pts_out, inds_out
# ---------- end ct_beamsfrommeshedges ----------

# ----
# Plate Creation
number_slider = Slider(3, range=0..10)
geo_2 = Geometry(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)
geo_3 = Geometry(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)
geo_4 = Geometry(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)
Z = UnitZ(Factor=1)
ct_plate_from_outline_and_thickness = CTPlateFromOutlineAndThickness(outline=geo_2, thickness=number_slider, vector=Z)  # -> Plate, Geometry; inputs thickness: Double, vector: Vector3d, openings: list, category: String, updateRefObj: Boolean
#   port outline: Referenced polyline, Guid of polyline in the active Rhino document.
#   port thickness: Thickness of the plate material.
#   port vector: Determines direction of the plate extrusion
#   port openings: List of openings in the plate.
#   port category: Category of a beam.
#   port updateRefObj: (optional) If True, the attributes in the referenced object will be updated/overwritten with the new values given here.
#   port Plate: Plate object(s).
#   port Geometry: Shape of the plate.
# ---------- ct_plate_from_outline_and_thickness: Python ----------
# r: compas_timber==1.0.1
# venv: sw25
"""Creates a Beam from a LineCurve."""

# flake8: noqa
import Grasshopper
import Rhino
import rhinoscriptsyntax as rs
import System
from compas.scene import Scene
from compas_rhino.conversions import polyline_to_compas
from compas_rhino.conversions import vector_to_compas

from compas_timber.elements import Plate as CTPlate
from compas_timber.ghpython.rhino_object_name_attributes import update_rhobj_attributes_name
from compas_timber.ghpython.ghcomponent_helpers import item_input_valid_cpython


class Plate(Grasshopper.Kernel.GH_ScriptInstance):
    def RunScript(self,
            outline,
            thickness: float,
            vector: Rhino.Geometry.Vector3d,
            openings: System.Collections.Generic.List[object],
            category: str,
            updateRefObj: bool):
        # minimum inputs required

        if not item_input_valid_cpython(ghenv, outline, "Outline") or not item_input_valid_cpython(ghenv, thickness, "Thickness"):
            return
        scene = Scene()
        guid, geometry = self._get_guid_and_geometry(outline)
        rhino_polyline = rs.coercecurve(geometry)
        line = polyline_to_compas(rhino_polyline.ToPolyline())
        v = vector_to_compas(vector) if vector else None
        o = []
        if openings:
            for o_outline in openings:
                o_guid, o_geometry = self._get_guid_and_geometry(o_outline)
                o_rhino_polyline = rs.coercecurve(o_geometry)
                o.append(polyline_to_compas(o_rhino_polyline.ToPolyline()))
        plate = CTPlate.from_outline_thickness(line, thickness, vector=v, openings=o)
        plate.attributes["rhino_guid"] = str(guid) if guid else None
        plate.attributes["category"] = category

        if updateRefObj and guid:
            update_rhobj_attributes_name(guid, "outline", str(outline))
            update_rhobj_attributes_name(guid, "thickness", str(thickness))
            update_rhobj_attributes_name(guid, "category", category)

        scene.add(plate.shape)
        geo = scene.draw()
        return plate, geo

    def _get_guid_and_geometry(self, line):  # TODO: move to ghpython_helpers
        # internalized curves and GH geometry will not have persistent GUIDs, referenced Rhino objects will
        # type hint on the input has to be 'ghdoc' for this to work
        guid = None
        geometry = line
        rhino_obj = Rhino.RhinoDoc.ActiveDoc.Objects.FindId(line)

        if rhino_obj:
            guid = line
            geometry = rhino_obj.Geometry
        return guid, geometry
# ---------- end ct_plate_from_outline_and_thickness ----------
ct_plate_from_top_and_bottom = CTPlateFromTopAndBottom(top=geo_3, bottom=geo_4)  # -> Plate, Geometry; inputs openings: list, category: String, updateRefObj: Boolean
#   port top: Top outline of plate. Referenced polyline, Guid of polyline in the active Rhino document.
#   port bottom: Bottom outline of plate. Referenced polyline, Guid of polyline in the active Rhino document.
#   port openings: List of openings in the plate.
#   port category: Category of a beam.
#   port updateRefObj: (optional) If True, the attributes in the referenced object will be updated/overwritten with the new values given here.
#   port Plate: Plate object(s).
#   port Geometry: Shape of the plate.
# ---------- ct_plate_from_top_and_bottom: Python ----------
# r: compas_timber==1.0.1
# venv: sw25
"""Creates a Beam from a LineCurve."""

# flake8: noqa
import Grasshopper
import Rhino
import rhinoscriptsyntax as rs
import System
from compas.scene import Scene
from compas_rhino.conversions import polyline_to_compas

from compas_timber.elements import Plate as CTPlate
from compas_timber.ghpython.rhino_object_name_attributes import update_rhobj_attributes_name
from compas_timber.ghpython.ghcomponent_helpers import item_input_valid_cpython


class PlateFromTopBottom(Grasshopper.Kernel.GH_ScriptInstance):
    def RunScript(self,
            top,
            bottom,
            openings: System.Collections.Generic.List[object],
            category: str,
            updateRefObj: bool):
        # minimum inputs required

        if not item_input_valid_cpython(ghenv, top, "top") or not item_input_valid_cpython(ghenv, bottom, "bottom"):
            return

        scene = Scene()

        t_guid, t_geometry = self._get_guid_and_geometry(top)
        b_guid, b_geometry = self._get_guid_and_geometry(bottom)
        t_rhino_polyline = rs.coercecurve(t_geometry)
        b_rhino_polyline = rs.coercecurve(b_geometry)
        top_line = polyline_to_compas(t_rhino_polyline.ToPolyline())
        bottom_line = polyline_to_compas(b_rhino_polyline.ToPolyline())

        o = []
        if openings:
            for o_outline in openings:
                if o_outline:
                    o_guid, o_geometry = self._get_guid_and_geometry(o_outline)
                    o_rhino_polyline = rs.coercecurve(o_geometry)
                    o.append(polyline_to_compas(o_rhino_polyline.ToPolyline()))

        plate = CTPlate(top_line, bottom_line, openings=o)
        plate.attributes["rhino_guid_a"] = str(t_guid) if t_guid else None
        plate.attributes["rhino_guid_b"] = str(b_guid) if b_guid else None
        plate.attributes["category"] = category

        if updateRefObj and t_guid:
            update_rhobj_attributes_name(t_guid, "outline_a", str(top_line))
            update_rhobj_attributes_name(b_guid, "outline_b", str(bottom_line))
            update_rhobj_attributes_name(t_guid, "category", category)

        scene.add(plate.shape)

        geo = scene.draw()

        return plate, geo

    def _get_guid_and_geometry(self, line):  # TODO: move to ghpython_helpers
        # internalized curves and GH geometry will not have persistent GUIDs, referenced Rhino objects will
        # type hint on the input has to be 'ghdoc' for this to work
        guid = None
        geometry = line
        rhino_obj = Rhino.RhinoDoc.ActiveDoc.Objects.FindId(line)

        if rhino_obj:
            guid = line
            geometry = rhino_obj.Geometry
        return guid, geometry
# ---------- end ct_plate_from_top_and_bottom ----------
