# Grasshopper definition 07_using_vscode.gh (Grasshopper 1.0.8)

# ---- group: This is needed only ONCE in the GH definition
auto_reload = Python3Script()  # -> ok
# ---------- auto_reload: Python ----------
"""
------------------------------
Using VS Code as Python editor
------------------------------

The simplest way to start using VS Code as our editor, is
to place our Python code in files located IN THE SAME FOLDER as our Grasshopper file.

After we have done that, we need 2 steps: 

1. Enable the COMPAS reloader on one component. This tells Grasshopper to watch for changes in the Pythoh files and reload if changed.
2. Every other component that uses Python code from external files needs to start with a method to ensure Grasshopper knows where to load the files from.

"""
# r: compas_timber==1.0.1
# venv: sw25

from compas_rhino.devtools import DevTools
DevTools.enable_reloader()
# ---------- end auto_reload ----------

# ----
python_3_script = Python3Script(x=auto_reload)  # -> out, a
# ---------- python_3_script: Python ----------
# r: compas_timber==1.0.1
# venv: sw25

"""
Scripts that use Python code located in external files
need to start with a call to DevTools.ensure_path()

Without this, on some platforms, Grasshopper will not know
where to find the file.
"""
from compas_rhino.devtools import DevTools
DevTools.ensure_path()

import compas
print(f"Hello COMPAS World! You have COMPAS v{compas.__version__} installed")
# ---------- end python_3_script ----------
panel = Panel(python_3_script.out)
