# Grasshopper definition 08_reciprocal_frame.gh (Grasshopper 1.0.8)

# Reciprocal Frame units
# Task Description: > Goal: Use the parametric definition of a Reciprocal Frame Unit (`RFUnit`) representing the fundamental building block of reciprocal frame structures and materialize it with compas_timber. An RF Unit is a 2D representation of the closed circuit of rods in an RF Structure. It's enclosed by a polygonal shape and it has exactly one connection point on each of its edges.
# 
# - Materialize it with `compas_timber` detecting the cycles automatically
# - Use two types of connections: TButtJoint and XLapJoint
# - Topics: compas_timber model, beams and connections
auto_reload = Python3Script()  # -> ok
# ---------- auto_reload: Python ----------
"""
------------------------------
Using VS Code as Python editor
------------------------------

The simplest way to start using VS Code as our editor, is
to place our Python code in files located IN THE SAME FOLDER as our Grasshopper file.

After we have done that, we need 2 steps: 

1. Enable the COMPAS reloader on one component. This tells Grasshopper to watch for changes in the Pythoh files and reload if changed.
2. Every other component that uses Python code from external files needs to start with a method to ensure Grasshopper knows where to load the files from.

"""
# r: compas_timber==1.0.1
# venv: sw25

from compas_rhino.devtools import DevTools
DevTools.enable_reloader()
# ---------- end auto_reload ----------

rf_unit = Python3Script(
    ready=auto_reload,
    sides=Slider(6, range=3..20),
    radius=Slider(1.6, range=0.1..3),
    start_eccentricity=Slider(0.405, range=-0.5..0.5),
    end_eccentricity=Slider(0.246, range=-0.5..0.5),
    overlap=Slider(0.328, range=0..1))  # -> segment_lines, shape_edges; inputs sides: Int32
# ---------- rf_unit: Python ----------
# r: compas_timber==1.0.1
# venv: sw25

from compas_rhino.devtools import DevTools
DevTools.ensure_path()

from compas.geometry import Polygon
from compas_rhino.conversions import line_to_rhino_curve

from rfunits import RFUnit

# Create a polygon
polygon = Polygon.from_sides_and_radius_xy(sides, radius)

# Create RF unit
unit = RFUnit(polygon, start_eccentricity=start_eccentricity, end_eccentricity=end_eccentricity, overlap=overlap)
unit.generate_segments()
unit.adjust_segments()

shape_edges = [line_to_rhino_curve(edge) for edge in unit.edges]
segment_lines = [line_to_rhino_curve(segment.line) for segment in unit.segments]
# ---------- end rf_unit ----------

unit_z = UnitZ(Factor=1)
ct_model = Python3Script(
    lines=rf_unit.segment_lines,
    width=Slider(0.06, range=0.01..1.1),
    height=Slider(0.08, range=0.01..1.1),
    z_vector=unit_z,
    process_joinery=Toggle(False))  # -> geo; inputs lines: list of Line, z_vector: Vector3d
# ---------- ct_model: Python ----------
# r: compas_timber==1.0.1
# venv: sw25

from compas_rhino.conversions import line_to_compas
from compas_rhino.conversions import vector_to_compas
from compas_timber.connections import XLapJoint
from compas_timber.connections import TButtJoint
from compas_timber.elements import Beam
from compas_timber.model import TimberModel

# 1. Convert the Z vector from Rhino to COMPAS
# [...add your code here...]

# 2. Create a new TimberModel()
# [...add your code here...]

# 3. For each input line...
# [...add your code here...]
    # 4. Convert the line to COMPAS and create a Beam.from_centerline() for it
    # [...add your code here...]
    # 5. Add the beam to the model
    # [...add your code here...]


# 6. Iterate over model's beams in pairs (wrapping around the last element)
# [...add your code here...]

    # 7. And create joints between each pair. Choose TButtJoint or XLapJoint types.
    # [...add your code here...]

# 8. Process all joinery
# [...add your code here...]

# 9. Output the beams' geometry for visualization
# [...add your code here...]
# ---------- end ct_model ----------
