# Grasshopper definition 09_brick_wall.gh (Grasshopper 1.0.8)

point = Point(Point(4.168928123, -2.95899519, 3.358713982))
script = Script(
    row_count=Slider(10, range=10..30),
    column_count=Slider(21, range=10..30),
    attractor_point=point,
    rotation_factor=Slider(0.1, range=0..10))  # -> out, geo; inputs attractor_point: Point3d
# ---------- script: Python ----------
# r: compas_timber==1.0.1
# venv: sw25

import math
from compas.geometry import Box
from compas.geometry import Point
from compas.scene import Scene
from compas_rhino.conversions import point_to_compas

attractor = point_to_compas(attractor_point)

scene = Scene()
xsize = 1.8
ysize = 1
zsize = 0.5
mortar_gap = 0.02

for col in range(int(column_count)):
    for row in range(int(row_count)):
        x = col * (xsize + mortar_gap)
        y = 0
        z = row * (zsize + mortar_gap)
        if row % 2 == 0:
            x += xsize / 2

        box = Box(xsize, ysize, zsize)
        point = Point(x, y, z)
        box.frame.point = point
        
        box.frame.rotate(attractor.distance_to_point(point) * rotation_factor, (0, 0, 1), point)
        scene.add(box)

geo = scene.draw()
# ---------- end script ----------
